# Grasshopper definition 00_Sandworm_ScanningMeshfromKinetic.gh (Grasshopper 1.0.7)
# Copyright: 2020
# plug-ins: SandWorm, Section To XY

# ----
# Getting Mesh from KINETIC
number_slider = Slider(213, range=0..250)
# HOW TO USE SANDWORM: To use Sandworm you will need a copy of Rhino 6, a Kinect for Windows v2 and have installed the Kinect for Windows Runtime 2.0.
number_slider_2 = Slider(1007, range=500..1100)
number_slider_3 = Slider(375, range=0..400)
# Step 2: Simplified Mesh
crv = Curve()
# Step 1: Scanned MESH
number_slider_4 = Slider(167, range=0..1000)
swsetup = SetupComponent(
    CalibrateSandworm=False,
    SensorHeight=number_slider_2,
    LeftColumns=number_slider,
    RightColumns=number_slider,
    TopRows=number_slider_3,
    BottomRows=number_slider_3,
    TickRate=33,
    KeepFrames=1,
    KinectType=Slider(2, range=0..10))  # -> Options, Info
sw_mesh = SandwormMesh(WaterLevel=number_slider_4, ContourInterval=10, AverageFrames=2, BlurRadius=5, SandwormOptions=swsetup.Options)  # -> Mesh, Analysis, Output
cluster = Cluster(G=sw_mesh.Mesh)
dam = DataDam(DataDataDamDelay10s=cluster, BufferDelay=10000000, BufferMode=0)
preview = CustomPreview(Geometry=sw_mesh.Analysis, Material=ColourSwatch(SwatchColor=RGB(9, 154, 237)))
scanned_mesh = Mesh(dam)

# ---- group: slope
# Step 4: Visualize scanned mesh from Kinetic
number_slider_5 = Slider(0, range=0..10)
slope = Slope(Mesh=scanned_mesh, Min=number_slider_5, Max=Slider(16.92, range=0..100))  # -> Mesh, Colors, Tags, Slope
legend = Legend(Colour=slope.Colors, Tags=slope.Tags, LegendType=1)

# ----
# Simplify the scanned surface:
# Surface > BREP> Deconstruct> get all faces> Get top face in the list of face > scale it to the original size> Divide the new surface by SurfaceDivide > get points from that Surface divide> Project 2 the scanned mesh > Surface from point again.
scanned_mesh_2 = Mesh(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)

# ---- group: Simplify Scanned Mesh
bbox = BoundingBox(Content=scanned_mesh_2, Plane=PlaneXY(0, 0, 0))  # -> Box, Box_2
debrep = DeconstructBrep(Brep=bbox.Box)  # -> Faces, Edges, Vertices
number_slider_6 = Slider(30, range=0..100)
item = ListItem(List=debrep.Faces, Index=4, Wrap=True)
area = Area(Geometry=item)  # -> Area, Centroid
scale = Scale(Geometry=item, Center=area.Centroid, Factor=0.99)  # -> Geometry, Transform
Z = UnitZ(Factor=1)
sdivide = DivideSurface(Surface=scale.Geometry, UCount=number_slider_6, VCount=Slider(44, range=0..100))  # -> Points, Normals, Parameters
project = ProjectPoint(Point=sdivide.Points, Direction=Z, Geometry=scanned_mesh_2)  # -> flatten(Point), Index

# ----
srfgrid = SurfaceFromPoints(Points=project.Point, UCount=expr("X+1", number_slider_6), Interpolate=False)

# ----
# Step 3: Get Contour line
# ANNO Bison plugin
number_slider_7 = Slider(1, range=0..10)
contour = Contour(Mesh=srfgrid, Interval=number_slider_7, Height=Slider(1, range=0..10), Tags=Slider(14, range=0..100))  # -> Major, Minor

clean = CleanTree(RemoveNulls=True, RemoveInvalid=True, RemoveEmpty=False, Tree=contour.Minor)
clean_2 = CleanTree(RemoveNulls=True, RemoveInvalid=True, RemoveEmpty=False, Tree=contour.Major)

crv_2 = Curve(clean)
crv_3 = Curve(clean_2)

# ==== cluster Cluster
# The scanned dimension
panel = Panel("47")
subtraction = Subtraction(A=panel, B="24")
# The real dimension of model
panel_2 = Panel("1400")
division = Division(A="24", B=subtraction)
division_2 = Division(A=panel_2, B="2260")
G = ClusterInput()
panel_3 = Panel(division_2)
# Scale the scanned surface
scale_nu = ScaleNU(Geometry=G, Plane=PlaneXY(0, 0, 0), ScaleX=division_2, ScaleY=division_2, ScaleZ=division)  # -> Geometry, Transform
G_2 = ClusterOutput(scale_nu.Geometry)
