# Grasshopper definition 01_BisonAnalysis_Water flow.gh (Grasshopper 1.0.7)
# plug-ins: Section To XY

# Simplify the scanned surface:
# Surface > BREP> Deconstruct> get all faces> Get top face in the list of face > scale it to the original size> Divide the new surface by SurfaceDivide > get points from that Surface divide> Project 2 the scanned mesh > Surface from point again.
# Water Flow Analysis
# 
# Sandworm Plugin
scanned_mesh = Mesh(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)

# ---- group: Simplify Scanned Mesh
bbox = BoundingBox(Content=scanned_mesh, Plane=PlaneXY(0, 0, 0))  # -> Box, Box_2
debrep = DeconstructBrep(Brep=bbox.Box)  # -> Faces, Edges, Vertices
number_slider = Slider(30, range=0..100)
item = ListItem(List=debrep.Faces, Index=4, Wrap=True)
area = Area(Geometry=item)  # -> Area, Centroid
scale = Scale(Geometry=item, Center=area.Centroid, Factor=0.99)  # -> Geometry, Transform
Z = UnitZ(Factor=1)
sdivide = DivideSurface(Surface=scale.Geometry, UCount=number_slider, VCount=Slider(44, range=0..100))  # -> Points, Normals, Parameters
project = ProjectPoint(Point=sdivide.Points, Direction=Z, Geometry=scanned_mesh)  # -> flatten(Point), Index

# ----
srfgrid = SurfaceFromPoints(Points=project.Point, UCount=expr("X+1", number_slider), Interpolate=False)

# ----
# create a point set based on the bounding box outline
# Water Flow Analysis
# 
# Without the Bison Plugin
# Visual Basic script to calculate the drainage lines and watersheds based on the input points
panel = Panel("input a mesh here")
mesh = Mesh(srfgrid)
bbox_2 = BoundingBox(Content=mesh, Plane=PlaneXY(0, 0, 0))  # -> Box, Box_2
debrep_2 = DeconstructBrep(Brep=bbox_2.Box)  # -> Faces, Edges, Vertices
number_slider_2 = Slider(40, range=0..100)
item_2 = ListItem(List=debrep_2.Faces, Index=5, Wrap=True)
num = Number(2)
num_2 = Integer(10000)
sdivide_2 = DivideSurface(Surface=item_2, UCount=number_slider_2, VCount=number_slider_2)  # -> Points, Normals, Parameters
vb = VBScript(pt=sdivide_2.Points, m=mesh, tol=num, maxsteps=num_2)  # -> out, A; inputs pt: Point3d, m: Mesh
# ---------- vb: VB ----------
    Dim ptl As New list(Of point3d)
    Dim pl As New plane(pt, vector3d.ZAxis)

    While ptl.count < maxsteps
      Dim mpt As meshpoint = m.ClosestMeshPoint(pl.origin, Double.MaxValue)
      pl = New plane(mpt.Point, m.NormalAt(mpt))
      If ptl.count > 0 AndAlso pl.OriginZ > ptl(ptl.count - 1).z Then Exit While
      ptl.add(pl.Origin)
      Dim an As Double = vector3d.VectorAngle(pl.XAxis, -vector3d.ZAxis, pl)
      pl.Rotate(an, pl.ZAxis)
      pl.Translate(pl.XAxis * tol)
    End While

    a = ptl
# ---------- end vb ----------
pt = Point(vb.A)
panel_2 = Panel("display drainage lines")
pline = PolyLine(Vertices=pt, Closed=False)

# ----
# Watershed
# Move water lines to see it above the mesh
number_slider_3 = Slider(11.151, range=0..100)
curve = Curve(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)
flow = Flow(Boundary=curve, Mesh=srfgrid, Grid=number_slider_3, Steps=Slider(61, range=0..70), Length=Slider(0.808, range=0..1))
panel_3 = Panel(flow)
Z_2 = UnitZ(Factor=Slider(8, range=0..10))

# ---- group: Rebuild to get smoother water flow
rebuild_curve = RebuildCurve(Curve=flow, Degree=Slider(1, range=0..10), Count=10, Tangents=False)

# ----
move = Move(Geometry=rebuild_curve, Motion=Z_2)  # -> Geometry, Transform
panel_4 = Panel(rebuild_curve)
preview = CustomPreview(Geometry=rebuild_curve, Material=ColourSwatch(SwatchColor=RGB(31, 92, 145)))
