# Grasshopper definition 02_Animated Agents.gh (Grasshopper 1.0.7)

# ---- group: road
# Road from PhysaRealm plugin
# Animated Agents
number_slider = Slider(20, range=0..100)
neg = Negative(Value=Slider(50, range=0..100))
neg_2 = Negative(Value=number_slider)
geo = Geometry([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])
Y = UnitY(Factor=neg)
Z = UnitZ(Factor=Slider(73, range=0..100))
X = UnitX(Factor=neg_2)
move = Move(Geometry=geo, Motion=Y)  # -> Geometry, Transform
move_2 = Move(Geometry=move.Geometry, Motion=X)  # -> Geometry, Transform
move_3 = Move(Geometry=move_2.Geometry, Motion=Z)  # -> Geometry, Transform

# ---- group: ANIMATED MOVEMENT / Reset if you change settings
button = Button()

# ---- group: ANIMATED MOVEMENT / Path Curves
crv = Curve(reparameterize(move_3.Geometry))

# ---- group: ANIMATED MOVEMENT / population for each curve
this_must_contain_a_population_number_fo = Panel("""5
5
5""")  # "This must contain a population number for each curve"
dup = DuplicateData(Data=this_must_contain_a_population_number_fo, Number=2, Order=True)

# ---- group: ANIMATED MOVEMENT / Enable to animate
timer = Timer(TimerInterval=100, Target=python)

# ---- group: ANIMATED MOVEMENT
start_hour = Panel("6")
start_min_sec = Panel("0")

# ---- group: ANIMATED MOVEMENT / Shape at origin
value_list = ValueList({"Person": 0, "Bicycle": 1}, selected="Person")
cir = Circle(Plane=PlaneXY(0, 0, 0), Radius=1.2)
curve = Curve(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)

# ---- group: ANIMATED MOVEMENT
# Agents
# Direction Arrows
# Field of View
stream_filter = StreamFilter(Gate=value_list, Stream0=cir, Stream1=curve)
swatch = ColourSwatch(SwatchColor=RGBA(0, 0, 0, 254))

# ---- group: ANIMATED MOVEMENT / Shape at origin (continued)
boundary = BoundarySurfaces(Edges=stream_filter)

# ---- group: ANIMATED MOVEMENT / Daily Timer
pt = Point(Point(-498, -56, 0))
time = ConstructTime(Hour=start_hour, Minute=start_min_sec, Second=start_min_sec)
end_hour = Panel("21")
end_min_sec = Panel("59")
time_2 = ConstructTime(Hour=end_hour, Minute=end_min_sec, Second=end_min_sec)
xy = XYPlane(Origin=pt)
rotate = Rotate(Geometry=xy, Angle=Slider(0, range=0..2), Plane=xy)  # -> Geometry, Transform

# ---- group: ANIMATED MOVEMENT / This is where the magic happens
Z_2 = UnitZ(Factor=1)
move_4 = Move(Geometry=crv, Motion=Z_2)  # -> Geometry, Transform
offset = OffsetCurve(Curve=move_4.Geometry, Distance=2, Plane=PlaneXY(0, 0, 0), Corners=1)
flip = FlipCurve(Curve=offset)  # -> flatten(Curve), Flag
merge = Merge(Data1=move_4.Geometry, Data2=flip.Curve)
increment = Slider(0.01, range=0..1)
len = Length(Curve=merge)
division = Division(A="100", B=len)
panel = Panel("1")
python = PythonScript(reset=button, lim="1", inc=increment, length=division, xx=Slider(650, range=0..650))  # -> out, a, b; inputs length: list
# ---------- python: Python ----------
if reset or 'counter' not in globals():
    counter = [0 for i in length]

for i,c in enumerate(counter):
    if c+inc*length[i] > lim:
        counter[i] = 0
    else:
        counter[i] += inc*length[i]

a = counter
b = [inc*i for i in length]
# ---------- end python ----------
multiplication = Multiplication(A=python.b, B=5)
item = ListItem(List=python.a, Index=0, Wrap=True)
Z_3 = UnitZ(Factor=0.5)
arc = Arc(Plane=PlaneXY(0, 0, 0), Radius=4, Angle=Domain(0, 3.141592654))  # -> Arc, Length

# ---- group: ANIMATED MOVEMENT / Durinal fluctuation in Population
graph = GraphMapper(
    item,
    x0=0,
    x1=1,
    y0=0,
    y1=1,
    container_name="Sine Summation",
    Equation0_px=[0.2381818146, 0.3690909147],
    Equation0_py=[0.1202896833, 0.2130436301],
    Equation1_px=[0.4636363685, 0.7050908804],
    Equation1_py=[0.08550673723, 0.682608366])

# ---- group: ANIMATED MOVEMENT / Daily Timer (continued)
intdate = InterpolateDate(DateA=time, DateB=time_2, Interpolation=item)
txt = Text(intdate)
format = Format(Format="Time {0}", Culture=127, Data0=txt)
tag = TextTag3D(Location=rotate.Geometry, Text=format, Size=20, Colour=swatch, Justification=7)

# ---- group: ANIMATED MOVEMENT / This is where the magic happens (continued)
remap = RemapNumbers(Value=graph, Source=Domain(0, 1), Target=dup)  # -> Mapped, Clipped
int = Integer(remap.Mapped)
python_2 = PythonScript(reset=button, t=multiplication, popl=int)  # -> out, a; inputs t: list, popl: list of Int32
# ---------- python_2: Python ----------
from ghpythonlib.treehelpers import list_to_tree
import random as rand

if reset or 'positions' not in globals():
    print "reset"
    positions = []
    for p in popl:
        rate = 1/p
        curve_p = []
        for n in range(p):
            if t>=rate*n:
                curve_p.append(rate*n)
        positions.append(curve_p)

#print positions
#print "This", positions
for i, crvs in enumerate(positions):
    for j, pos in enumerate(crvs):

        if pos+t[i]>=1:
            #print pos, t[i], pos+t[i]
            #positions[i][j] = 
            crvs.pop(j)
        else:
            positions[i][j] = pos+t[i]
        #Add new points
        x=len(crvs)
        #print x
        if x > popl[i] :  
            #print "pop", x, popl[i]
            positions[i].pop(x-1)
        elif popl[i] == len(crvs):
            pass
        else:
            if rand.randint(0,9)>2:
                positions[i].insert(0, 0)

a = list_to_tree(positions)
# ---------- end python_2 ----------
cluster = Cluster_2(C=merge, graph=python_2.a, x=Slider(3, range=0..10))  # -> V_2, G, V
pl = ConstructPlane(Origin=cluster.G, XAxis=cluster.V, YAxis=cluster.V_2)
data = Data(flatten(pl))
python_3 = GhPythonScript(pts=data, min=Slider(6, range=0..10), max=Slider(20, range=0..20), conn=Slider(5, range=0..10))  # -> out, a; inputs pts: list of Point3d, min: Int32, max: Int32, conn: Int32
# ---------- python_3: Python ----------
import rhinoscriptsyntax as rs
from ghpythonlib import treehelpers as th

count = conn

Structure = []

for p_i, point in enumerate(pts):
    closestPoints = []
    local_copy = pts[:]
    local_copy.pop(p_i)
    for c in range(count):
        i = rs.PointArrayClosestPoint(local_copy, point)
        p = local_copy.pop(i)
        if min < rs.Distance(point, p) < max:
            closestPoints.append( p )
    Structure.append(closestPoints)

a = th.list_to_tree(Structure)
# ---------- end python_3 ----------
move_5 = Move(Geometry=data, Motion=Z_3)  # -> Geometry, Transform
orient = Orient(Geometry=arc.Arc, Source=PlaneXY(0, 0, 0), Target=data)  # -> Geometry, Transform
orient_2 = Orient(Geometry=boundary, Source=PlaneXY(0, 0, 0), Target=move_5.Geometry)  # -> Geometry, Transform

# ---- group: ANIMATED MOVEMENT / Display
preview = CustomPreview(Geometry=orient_2.Geometry, Material=ColourSwatch(SwatchColor=RGBA(230, 0, 0, 254)))
vdisex = VectorDisplayEx(Point=cluster.G, Vector=cluster.V_2, Colour=ColourSwatch(SwatchColor=RGBA(0, 0, 0, 254)), Width=2)
preview_2 = CustomPreview(Geometry=orient.Geometry, Material=ColourSwatch(SwatchColor=RGBA(112, 112, 112, 166)))

# ==== cluster Cluster_2
graph = ClusterInput()
graph_2 = GraphMapper(
    graph,
    x0=0,
    x1=1,
    y0=0,
    y1=1,
    container_name="Bezier",
    cpx=[0, 0.833191812, 0.231562078, 1],
    cpy=[0, 0.3998337984, 0.6404848099, 1])
panel = Panel(graph)
cluster = Cluster(A="0", B=graph_2)
C = ClusterInput()
x = ClusterInput()
eval = EvaluateCurve(Curve=reparameterize(simplify(graft(C))), Parameter=simplify(cluster))  # -> Point, Tangent, Angle
Z = UnitZ(Factor=1)
neg = Negative(Value=x)
vrot = Rotate(Vector=eval.Tangent, Axis=Z, Angle="pi/2")
devec = DeconstructVector(Vector=vrot)  # -> XComponent, YComponent, ZComponent
dom = ConstructDomain(DomainStart=neg, DomainEnd=x)
random = Random(Range=dom, Number=4, Seed=2)
vec = VectorXYZ(XComponent=devec.XComponent, YComponent=devec.YComponent, ZComponent=0)  # -> Vector, Length
amp = Amplitude(Vector=eval.Tangent, Amplitude=8)
amp_2 = Amplitude(Vector=vec.Vector, Amplitude=random)
move = Move(Geometry=eval.Point, Motion=amp_2)  # -> Geometry, Transform
V = ClusterOutput(vec.Vector)
G = ClusterOutput(move.Geometry)
V_2 = ClusterOutput(amp)

# ==== cluster Cluster
A = ClusterInput()
B = ClusterInput()
lng = ListLength(List=B)
addition = Addition(A=graft(A), B=B)  # -> simplify(Result)
equals = Equality(FirstNumber=lng, SecondNumber=0)  # -> Equality, Inequality
multiplication = Multiplication(A=equals.Inequality, B=addition)
panel = Panel(multiplication)
larger = LargerThan(FirstNumber=multiplication, SecondNumber=1)  # -> LargerThan, OrEqualTo
subtraction = Subtraction(A=multiplication, B=larger.LargerThan)
R = ClusterOutput(subtraction)
