# Grasshopper definition 03_Bison Analysis_Viewshed.gh (Grasshopper 1.0.7)
# plug-ins: Human, Section To XY

# ---- group: road
# Road from PhysaRealm plugin
# Bison Analysis
# 
# Viewshed
number_slider = Slider(20, range=0..100)
neg = Negative(Value=Slider(50, range=0..100))
neg_2 = Negative(Value=number_slider)
geo = Geometry([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])
Y = UnitY(Factor=neg)
Z = UnitZ(Factor=Slider(73, range=0..100))
X = UnitX(Factor=neg_2)
move = Move(Geometry=geo, Motion=Y)  # -> Geometry, Transform
move_2 = Move(Geometry=move.Geometry, Motion=X)  # -> Geometry, Transform
move_3 = Move(Geometry=move_2.Geometry, Motion=Z)  # -> Geometry, Transform

# ----
# Simplify the scanned surface:
# Surface > BREP> Deconstruct> get all faces> Get top face in the list of face > scale it to the original size> Divide the new surface by SurfaceDivide > get points from that Surface divide> Project 2 the scanned mesh > Surface from point again.
scanned_mesh = Mesh(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)

# ---- group: Simplify Scanned Mesh
bbox = BoundingBox(Content=scanned_mesh, Plane=PlaneXY(0, 0, 0))  # -> Box, Box_2
debrep = DeconstructBrep(Brep=bbox.Box)  # -> Faces, Edges, Vertices
number_slider_2 = Slider(30, range=0..100)
item = ListItem(List=debrep.Faces, Index=4, Wrap=True)
area = Area(Geometry=item)  # -> Area, Centroid
scale = Scale(Geometry=item, Center=area.Centroid, Factor=0.99)  # -> Geometry, Transform
Z_2 = UnitZ(Factor=1)
sdivide = DivideSurface(Surface=scale.Geometry, UCount=number_slider_2, VCount=Slider(44, range=0..100))  # -> Points, Normals, Parameters
project = ProjectPoint(Point=sdivide.Points, Direction=Z_2, Geometry=scanned_mesh)  # -> flatten(Point), Index

# ----
srfgrid = SurfaceFromPoints(Points=project.Point, UCount=expr("X+1", number_slider_2), Interpolate=False)

# ---- group: Get a curve + point on curve
item_2 = ListItem(List=move_3.Geometry, Index=Slider(4, range=0..18), Wrap=True)
previewlw = CustomPreviewLineweights(Geometry=item_2, Shader=ColourSwatch(SwatchColor=RGB(255, 255, 255)), Thickness=3, Absolute=False)
curvepoint = PointOnCurve(item_2, parameter=0.328)
pt = Point(curvepoint)

# ----
crv = Curve(item_2)
preview = CustomPreview(
    Geometry=crv,
    Material={diffuse=RGB(221, 160, 221), emission=RGB(66, 48, 66), shine=0.5, specular=RGB(255, 255, 255), transparency=0})

# ---- group: viewshed
# Move lines to see it above the mesh
number_slider_3 = Slider(2.3, range=0..10)
mesh_closest_point = MeshClosestPoint(Point=curvepoint, Mesh=srfgrid)  # -> Point, Index, Parameter
cir = Circle(Plane=curvepoint, Radius=5)
# Evaluate mesh at that point
mesh_eval = MeshEval(Mesh=srfgrid, Parameter=mesh_closest_point.Parameter)  # -> Point, Normal, Colour
unit_z = UnitZ(Factor=number_slider_3)
boundary = BoundarySurfaces(Edges=cir)
preview_2 = CustomPreview(
    Geometry=boundary,
    Material={diffuse=RGB(221, 160, 221), emission=RGB(66, 48, 66), shine=0.5, specular=RGB(255, 255, 255), transparency=0})
move_4 = Move(Geometry=mesh_eval.Point, Motion=unit_z)  # -> Geometry, Transform
sphere = Sphere(Base=move_4.Geometry, Radius=0.5)
viewshed = Viewshed(Mesh=srfgrid, Viewpoint=move_4.Geometry)
custom_preview = CustomPreview(Geometry=sphere, Material=ColourSwatch(SwatchColor=RGB(41, 230, 41)))
Z_3 = UnitZ(Factor=Slider(10, range=0..10))
move_5 = Move(Geometry=viewshed, Motion=Z_3)  # -> Geometry, Transform
custom_preview_2 = CustomPreview(Geometry=move_5.Geometry, Material=ColourSwatch(SwatchColor=RGB(255, 91, 152)))
