# Grasshopper definition 04_Physarealm_ABM Analysis.gh (Grasshopper 1.0.7)
# plug-ins: Physarealm, Shortest Walk in Gh

# ----
# Physarealm Plugin
# 
# Set the focused area as a brep
# Set the starting points of agents
# Set the destination points or attractor points
number_slider = Slider(1, range=0..1)
death_distance_setting = DeathDistanceSetting(DeathDistance=Slider(31, range=0..70))
birth_death_setting = BirthDeathSetting(
    DivisionDetectRadius=2,
    DivisionMin=0,
    DivisionMax="1",
    DeathDetectRadius=number_slider,
    DeathMin=0,
    DeathMax=Slider(12, range=0..100))
sensor_setting = SensorSetting(SensorAngle=22.5, RotateAngle=45, SensorOffset=7)
speed_setting = SpeedSetting(MaxSpeed=Slider(9, range=0..10))

entrance_point_destination = Point([Point(-782.1131674, -150.9172241, 0), Point(-1068.605853, -120.4618883, 0), Point(-1177.800126, 509.6751868, 0), Point(-232.2802628, 258.4837366, 0), Point(-566.4972791, 248.9282307, 0), Point(103.966078, -54.70649315, 0), Point(-404.1405875, 1060.95758, 0), Point(-1858.926872, -30.15829832, 0), Point(-1456.686539, -383.2096758, 0)])
starting_points = Point([Point(-237.320737, 1365.379617, 0), Point(510.2154662, -241.7780287, 0)])
focused_area_brep = Brep(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)
point_emitter = PointEmitter(Points=starting_points)
points_food = PointsFood(Points=entrance_point_destination)
brepenvir = BrepEnvironment(XResolution=100, YResolution=100, ZResolution=100, Brep=focused_area_brep)

# ---- group: Click on this to get the agent move around
boolean_toggle = BooleanToggle(True)

# ---- group: Enable timer
timer = Timer(TimerInterval=20, Target=physarealm)  # disabled

# ---- group: ABM analysis
physarealm = Physarealm(
    Environment=brepenvir,
    Emitter=point_emitter,
    Food=points_food,
    Settings=[birth_death_setting, speed_setting, sensor_setting, death_distance_setting],
    Reset=boolean_toggle)  # -> ChemoAttractorField, Population, Iteration
population_position = PopulationPosition(Population=physarealm.Population)

# ---- group: Closest points to make the walking route
cps = ClosestPoints(Point=graft(population_position), Cloud=flatten(population_position), Count=Slider(6, range=0..10))  # -> ClosestPoint, CPIndex, Distance

# ---- group: The direct routes from the Starting Points to Destination Points
destination_points = Point(entrance_point_destination)
starting_points_2 = Point(starting_points)
ln = Line(StartPoint=graft(starting_points_2), EndPoint=destination_points)
project = Project(Geometry=ln, Plane=PlaneXY(0, 0, 0))  # -> flatten(Geometry), Transform

# ---- group: Project the walking line to XY Plane
ln_2 = Line(StartPoint=graft(population_position), EndPoint=cps.ClosestPoint)
project_2 = Project(Geometry=ln_2, Plane=PlaneXY(0, 0, 0))  # -> Geometry, Transform

# ----
shortwalk = ShortestWalk(Curves=flatten(project_2.Geometry), WantedPath=project.Geometry)  # -> ShortestWalk, Succession, Direction, Length

# ---- group: Rebuild a smoother polyline, set degree > 1
reb = RebuildCurve(Curve=shortwalk.ShortestWalk, Degree3=3, Count=10, Tangents=False)

# ----
preview = CustomPreview(Geometry=reb, Material=ColourSwatch(SwatchColor=RGB(255, 54, 54)))
