# Grasshopper definition 05_IsovistAnalysis.gh (Grasshopper 1.0.7)
# plug-ins: DeCodingSpaces, Human

ground_surface = Curve(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)
# 3D Isovist Analysis
# 
# Decoding Space Plugin
obstacle_buildings = Curve([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])
far_people_see = Panel("2000")

# ----
# Road from PhysaRealm plugin
# Isovist Analysis
# IMPORTANT NOTE!
# 
# All the necessary inputs for this example are already embedded in this script.
# If the geometry doesn’t show up in rhino, please select the grasshopper component which contains the geometry --> right click on grasshopper canvas and select “Zoom on preview”
number_slider = Slider(20, range=0..100)
neg = Negative(Value=Slider(50, range=0..100))
neg_2 = Negative(Value=number_slider)
geo = Geometry([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])
Y = UnitY(Factor=neg)
Z = UnitZ(Factor=Slider(30, range=0..100))
X = UnitX(Factor=neg_2)
move = Move(Geometry=geo, Motion=Y)  # -> Geometry, Transform
move_2 = Move(Geometry=move.Geometry, Motion=X)  # -> Geometry, Transform
move_3 = Move(Geometry=move_2.Geometry, Motion=Z)  # -> Geometry, Transform

resolution = Slider(200, range=0..200)
building_mesh = Mesh(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)
project = Project(Geometry=obstacle_buildings, Plane=PlaneXY(0, 0, 0))  # -> Geometry, Transform
boundary = BoundarySurfaces(Edges=ground_surface)

# ---- group: Get a curve + point on curve
item = ListItem(List=move_3.Geometry, Index=Slider(9, range=0..18), Wrap=True)
previewlw = CustomPreviewLineweights(Geometry=item, Shader=ColourSwatch(SwatchColor=RGB(255, 255, 255)), Thickness=3, Absolute=False)
viewpoint = Slider(0.99, range=0..0.99)
crv = Curve(item)
preview = CustomPreview(
    Geometry=crv,
    Material={diffuse=RGB(221, 160, 221), emission=RGB(66, 48, 66), shine=0.5, specular=RGB(255, 255, 255), transparency=0})
eval = EvaluateCurve(Curve=reparameterize(item), Parameter=Slider(1, range=0..1))  # -> Point, Tangent, Angle

# ---- group: Isovist Analysis / Obstable and viewpoints must be on the same plane
planesrf = PlaneSurface(Plane=item, XSize=Domain(-10, 10), YSize=Domain(-10, 10))
project_2 = Project(Geometry=obstacle_buildings, Plane=planesrf)  # -> Geometry, Transform

# ---- group: Isovist Analysis
ivist = IsoVist(Plane=eval.Point, Count=resolution, Radius=far_people_see, Obstacles=project_2.Geometry)  # -> Points, Distance, Index
pline = PolyLine(Vertices=ivist.Points, Closed=True)
planar = PlanarSrf(Edges=pline)
preview_2 = CustomPreview(Geometry=planar, Shader=ColourSwatch(SwatchColor=RGB(255, 24, 87)))

# ---- group: Simplified Mesh from Kinetic
# Simplify the scanned surface:
# Surface > BREP> Deconstruct> get all faces> Get top face in the list of face > scale it to the original size> Divide the new surface by SurfaceDivide > get points from that Surface divide> Project 2 the scanned mesh > Surface from point again.
scanned_mesh = Mesh(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)

# ---- group: Simplified Mesh from Kinetic / Simplify Scanned Mesh
bbox = BoundingBox(Content=scanned_mesh, Plane=PlaneXY(0, 0, 0))  # -> Box, Box_2
debrep = DeconstructBrep(Brep=bbox.Box)  # -> Faces, Edges, Vertices
number_slider_2 = Slider(30, range=0..100)
item_2 = ListItem(List=debrep.Faces, Index=4, Wrap=True)
area = Area(Geometry=item_2)  # -> Area, Centroid
scale = Scale(Geometry=item_2, Center=area.Centroid, Factor=0.99)  # -> Geometry, Transform
Z_2 = UnitZ(Factor=1)
sdivide = DivideSurface(Surface=scale.Geometry, UCount=number_slider_2, VCount=Slider(44, range=0..100))  # -> Points, Normals, Parameters
project_3 = ProjectPoint(Point=sdivide.Points, Direction=Z_2, Geometry=scanned_mesh)  # -> flatten(Point), Index

# ---- group: Project viewpoint to scanned mesh
height = Slider(10, range=0..10)
meshcp = MeshClosestPoint(Point=eval.Point, Mesh=scanned_mesh)  # -> Point, Index, Parameter
Z_3 = UnitZ(Factor=height)
move_4 = Move(Geometry=meshcp.Point, Motion=Z_3)  # -> Geometry, Transform

# ---- group: Simplified Mesh from Kinetic (continued)
srfgrid = SurfaceFromPoints(Points=project_3.Point, UCount=expr("X+1", number_slider_2), Interpolate=False)

# ----
faceb = FaceBoundaries(Mesh=srfgrid)
boundary_2 = BoundarySurfaces(Edges=faceb)
join = BrepJoin(Breps=boundary_2)  # -> Breps, Closed
brep = Brep(join.Breps)

# ---- group: Convert MESH into BREP
faceb_2 = FaceBoundaries(Mesh=building_mesh)
boundary_3 = BoundarySurfaces(Edges=faceb_2)
join_2 = BrepJoin(Breps=boundary_3)  # -> Breps, Closed
brep_2 = Brep(join_2.Breps)
debrep_2 = DeconstructBrep(Brep=[brep_2, brep])  # -> flatten(Faces), Edges, Vertices
previewmat = CustomPreviewMaterials(Geometry=brep_2, DiffuseColor=RGB(255, 255, 255))

# ---- group: 3D Isovist
vantage_points_from_isovist_route = Point(move_4.Geometry)
number_slider_3 = Slider(299, range=0..1000)
isovist3d = Isovist3D(
    VantagePointS=vantage_points_from_isovist_route,
    ObstacleSurfaces=debrep_2.Faces,
    GroundSurfaces=boundary,
    ViewingDirection=eval.Tangent,
    ViewingRange=Slider(2000, range=0..10000),
    HorizontalViewingAngle=Slider(120, range=0..1000),
    VerticalViewingAngle=Slider(58, range=0..180),
    HorizontalPrecision=number_slider_3,
    VerticalPrecision=number_slider_3,
    CalculateIsovistGeometry=Toggle(True),
    GroundAtZero=True,
    GroundAtZero_2=True,
    UseGPU=True)  # -> RaysGeometry, SurfacesToRays, RaysLength, RaysToVantagePoints, Volume, Mesh, ObjectVisibility

# ----
volume = Integer(flatten(isovist3d.Volume))

# ---- group: Get Isovist Ray to buildings
pshift = ShiftPaths(Data=isovist3d.RaysToVantagePoints, Offset=-1)
item_3 = ListItem(List=isovist3d.RaysLength, Index=pshift, Wrap=True)
item_4 = ListItem(List=isovist3d.RaysGeometry, Index=pshift, Wrap=True)
vec = Vector(item_4)
length = Number(item_3)
amp = Amplitude(Vector=vec, Amplitude=length)
isovist_rays = Vector(amp)

# ----
rtvp = Integer(isovist3d.RaysToVantagePoints)
lng = ListLength(List=rtvp)
pshift_2 = ShiftPaths(Data=lng, Offset=-1)
ma = MassAddition(Input=pshift_2)  # -> Result, PartialResults
division = Division(A=pshift_2, B=ma.Result)
item_5 = ListItem(List=division, Index=Slider(0, range=0..10), Wrap=True)
item_6 = ListItem(List=division, Index=Slider(1, range=0..10), Wrap=True)
item_7 = ListItem(List=division, Index=Slider(2, range=0..10), Wrap=True)
rayportion_obstacles = Number(flatten(item_6))
rayportion_ground = Number(flatten(item_7))
rayportion_sky = Number(flatten(item_5))

# ---- group: ray geometry
number_slider_4 = Slider(0, range=0..10)
vantage_points = Point(vantage_points_from_isovist_route)
isovist_rays_2 = Vector(isovist3d.RaysGeometry)
rtvp_2 = Integer(isovist3d.RaysToVantagePoints)
path = ConstructPath(Indices=[number_slider_4, Slider(1, range=0..2)])
branch = TreeBranch(Tree=rtvp_2, Path=path, MaintainPaths=True)
item_8 = ListItem(List=isovist_rays_2, Index=branch, Wrap=True)
item_9 = ListItem(List=vantage_points, Index=number_slider_4, Wrap=True)
isovist_rays_3 = Vector(item_8)
vdis = VectorDisplay(Anchor=item_9, Vector=isovist_rays_3)

# ---- group: visualize isovist rays / visualize isovist rays from viewpoints
number_slider_5 = Slider(0, range=0..100)
vantage_points_2 = Point(vantage_points_from_isovist_route)
isovist_rays_4 = Vector(isovist_rays)
branch_2 = TreeBranch(Tree=simplify(isovist_rays_4), Path=number_slider_5, MaintainPaths=True)
item_10 = ListItem(List=vantage_points_2, Index=number_slider_5, Wrap=True)
vec_2 = Vector(branch_2)
vdis_2 = VectorDisplay(Anchor=item_10, Vector=vec_2)

# ---- group: Calculation Ray Lengths
complete_list_ray_length = Number(length)
equals = Equality(FirstNumber=complete_list_ray_length, SecondNumber=0)  # -> Equality, Inequality
cull = CullPattern(List=complete_list_ray_length, CullPattern=equals.Inequality)
lng_2 = ListLength(List=cull)
ma_2 = MassAddition(Input=cull)  # -> flatten(Result), PartialResults
avr = Average(Input=cull)  # -> flatten(ArithmeticMean)
sort = SortList(Keys=cull)  # -> Keys, ValuesA
rev = ReverseList(List=sort.Keys)
lng_3 = ListLength(List=complete_list_ray_length)
expression = Expression(x=cull, y=avr, Expression="(x-y)²")
item_11 = ListItem(List=sort.Keys, Index=0, Wrap=True)  # -> flatten(Item)
item_12 = ListItem(List=rev, Index=0, Wrap=True)  # -> flatten(Item)
ma_3 = MassAddition(Input=expression)  # -> Result, PartialResults
ray_count = Number(lng_3)
division_2 = Division(A=ma_3.Result, B=ray_count)
sqrt = SquareRoot(Value=division_2)  # -> flatten(Result)
item_13 = ListItem(List=sort.Keys, Index=expr("x/2", lng_2), Wrap=True)  # -> flatten(Item)
raylength_sum = Number(ma_2.Result)
raylength_max = Number(item_12)
raylength_min = Number(item_11)
ray_length_median = Number(item_13)
raylength_mean = Number(avr)
raylength_std = Number(sqrt)
