# Grasshopper definition 06_Line for RoboticArm.gh (Grasshopper 1.0.7)

# ---- group: Walking route
# Generate Planes for UR10 - Robotic Arm
# Along the curve
walking_route = Curve(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)
Z = UnitZ(Factor=Slider(100, range=0..100))
move = Move(Geometry=walking_route, Motion=Z)  # -> Geometry, Transform

# ---- group: Example get the robotic movement for a shape / Walking Curve Sketch
# Generate Planes for UR10 - Robotic Arm
# From the center line
crv = Curve(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)
crv_2 = Curve(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)
crv_3 = Curve(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)
crv_4 = Curve(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)

# ----
simplified_mesh = Mesh(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)

# ---- group: Project walking route to scanned mesh
divide = DivideCurve(Curve=move.Geometry, Count=100, Kinks=False)  # -> Points, Tangents, Parameters
meshcp = MeshClosestPoint(Point=divide.Points, SimplifiedMesh=simplified_mesh)  # -> Point, Index, Parameter
pline = PolyLine(Vertices=meshcp.Point, Closed=False)
reb = RebuildCurve(Curve=pline, Degree=2, Count=10, Tangents=False)

# ---- group: Project Curve into Mesh with C#
unit_z = UnitZ(Factor=1)
projecttomesh = CSharpScript(Curve=move.Geometry, Simplified_Mesh=simplified_mesh, Direction=unit_z)  # -> out, graft(A); inputs Curve: Curve, Simplified_Mesh: Mesh, Direction: Vector3d
# ---------- projecttomesh: C# usings ----------
using System.IO;
using System.Linq;
using System.Data;
using System.Drawing;
using System.Reflection;
using System.Windows.Forms;
using System.Xml;
using System.Xml.Linq;
using System.Runtime.InteropServices;

using Rhino.DocObjects;
using Rhino.Collections;
using GH_IO;
using GH_IO.Serialization;
# ---------- projecttomesh: C# ----------
  if (null != Curve && null != Mesh && Direction.IsValid)
  {
  var tol = RhinoDoc.ActiveDoc.ModelAbsoluteTolerance;
  A = Curve.ProjectToMesh(Curve, Mesh, Direction, tol);
}
# ---------- end projecttomesh ----------

# ---- group: Example get the robotic movement for a shape
# Number of points on line
number_slider = Slider(47, range=0..100)

# ---- group: Example get the robotic movement for a shape / Pattern of tilt planes 0 - 1 - 0 - 1
division = Division(A=number_slider, B="2")
int = Integer(division)
repeat = RepeatData(Data="1", Length=int)
repeat_2 = RepeatData(Data="-1", Length=expr("x+1", int))
weave = Weave(Pattern=[0, 1], Stream0=repeat, Stream1=repeat_2, NullGaps=False)
multiplication = Multiplication(A=weave, B=Slider(90, range=0..100))
rad = Radians(Degrees=multiplication)

# ---- group: Example get the robotic movement for a shape
# Rotation of the planes
dom = ConstructDomain(DomainStart=0, DomainEnd=1)
range = Range(Domain=dom, Steps=number_slider)
graph = GraphMapper(range, x0=0, x1=1, y0=0, y1=1, container_name="Bezier", cpx=[0, 0, 0.9770383835, 1], cpy=[1, 0, 0.01212209463, 1])
dom_2 = ConstructDomain(DomainStart=Slider(30, range=0..100), DomainEnd=Slider(84, range=0..100))
remap = RemapNumbers(Value=graph, Source=dom, Target=dom_2)  # -> Mapped, Clipped
rad_2 = Radians(Degrees=remap.Mapped)

# ---- group: Get Planar planes - Move up to get the second planar - rotate 3D 90degree Axes X
number_slider_2 = Slider(26, range=0..100)
pframes = PerpFrames(Curve=reb, Count=number_slider_2, Align=True)  # -> Frames, Parameters
deplane = DeconstructPlane(Plane=pframes.Frames)  # -> Origin, XAxis, YAxis, ZAxis
vdis = VectorDisplay(Anchor=deplane.Origin, Vector=deplane.YAxis)
rot3d = Rotate3D(Geometry=pframes.Frames, Angle="pi/2", Center=deplane.Origin, Axis=deplane.XAxis)  # -> Geometry, Transform
pln = Plane(rot3d.Geometry)

# ----
dom_3 = ConstructDomain(DomainStart=0, DomainEnd=1)
range_2 = Range(Domain=dom_3, Steps=number_slider_2)
remap_value = GraphMapper(range_2, x0=0, x1=1, y0=0, y1=1, container_name="Sine", Equation_px=[0, 0.1021746174], Equation_py=[0, 0.7344202995])
dom_4 = ConstructDomain(DomainStart=30, DomainEnd=165)
remap_2 = RemapNumbers(Value=remap_value, Source=dom_3, Target=dom_4)  # -> Mapped, Clipped

# ---- group: Example get the robotic movement for a shape
# depth and position of imprint
number_slider_3 = Slider(34, range=0..100)
dom_5 = ConstructDomain(DomainStart=0, DomainEnd=1)
dom_6 = ConstructDomain(DomainStart=Slider(0, range=0..100), DomainEnd=number_slider_3)
remap_3 = RemapNumbers(Value=graph, Source=dom_5, Target=dom_6)  # -> Mapped, Clipped

# ---- group: Rotate all planes along the curve
rad_3 = Radians(Degrees=remap_2.Mapped)
deplane_2 = DeconstructPlane(Plane=pln)  # -> Origin, XAxis, YAxis, ZAxis
rot3d_2 = Rotate3D(Geometry=pln, Angle=rad_3, Center=deplane_2.Origin, Axis=deplane_2.ZAxis)  # -> Geometry, Transform

# ---- group: Move up Z, to get the second plane
deplane_3 = DeconstructPlane(Plane=rot3d_2.Geometry)  # -> Origin, XAxis, YAxis, ZAxis
neg = Negative(Value=deplane_3.ZAxis)
multiplication_2 = Multiplication(A=neg, B=Slider(50, range=0..100))
move_2 = Move(Geometry=rot3d_2.Geometry, Motion=multiplication_2)  # -> Geometry, Transform

# ---- group: Always set the first up, then down, then up
weave_2 = Weave(
    Pattern=[0, 1],
    Stream0=flatten(rot3d_2.Geometry),
    Stream1=flatten(move_2.Geometry),
    Stream2=flatten(move_2.Geometry),
    NullGaps=False)

# ---- group: Final line
pline_2 = PolyLine(Vertices=weave_2, Closed=False)

# ---- group: Example get the robotic movement for a shape
unit_z_2 = UnitZ(Factor=1)
walking_curve = Curve(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)
projecttomesh_2 = CSharpScript(Curve=walking_curve, Mesh=simplified_mesh, Direction=unit_z_2)  # -> out, graft(A); inputs Curve: Curve, Mesh: Mesh, Direction: Vector3d
# ---------- projecttomesh_2: C# ----------
    if (null != Curve && null != Mesh && Direction.IsValid)
    {
      var tol = RhinoDoc.ActiveDoc.ModelAbsoluteTolerance;
      A = Curve.ProjectToMesh(Curve, Mesh, Direction, tol);
    }
# ---------- end projecttomesh_2 ----------

# ---- group: Example get the robotic movement for a shape / Get upper axes
# Get a straight line from curve
end = EndPoints(Curve=projecttomesh_2.A)  # -> Start, End
ln = Line(StartPoint=end.Start, EndPoint=end.End)
base_curve = Curve(ln)
Z_2 = UnitZ(Factor=Slider(10, range=0..10))
move_3 = Move(Geometry=base_curve, Motion=Z_2)  # -> Geometry, Transform
midpt = CurveMiddle(Curve=move_3.Geometry)
scale = Scale(Geometry=move_3.Geometry, Center=midpt, Factor=Slider(0.614, range=0..1))  # -> Geometry, Transform

# ---- group: Example get the robotic movement for a shape / Planar Planes
lower_curve = Curve(base_curve)
divide_2 = DivideCurve(Curve=lower_curve, Count=number_slider, Kinks=False)  # -> Points, Tangents, Parameters
pframe = PerpFrame(Curve=lower_curve, Parameter=divide_2.Parameters)

# ---- group: Example get the robotic movement for a shape
deplane_4 = DeconstructPlane(Plane=pframe)  # -> Origin, XAxis, YAxis, ZAxis
neg_2 = Negative(Value=deplane_4.XAxis)
multiplication_3 = Multiplication(A=neg_2, B=remap_3.Mapped)
multiplication_4 = Multiplication(A=deplane_4.YAxis, B=1)
rev = ReverseList(List=weave)
multiplication_5 = Multiplication(A=rev, B=flatten(multiplication_3))
weave_3 = Weave(Pattern=[0, 1], Stream0=multiplication_4, Stream1=multiplication_5, NullGaps=False)

# ---- group: Example get the robotic movement for a shape / Rotate Planars
deplane_5 = DeconstructPlane(Plane=pframe)  # -> Origin, XAxis, YAxis, ZAxis
rot3d_3 = Rotate3D(Geometry=pframe, Angle=rad, Center=deplane_5.Origin, Axis=Vector(0, 0, 1))  # -> Geometry, Transform
deplane_6 = DeconstructPlane(Plane=rot3d_3.Geometry)  # -> Origin, XAxis, YAxis, ZAxis
rot3d_4 = Rotate3D(Geometry=rot3d_3.Geometry, Angle=rad_2, Center=deplane_6.Origin, Axis=deplane_6.XAxis)  # -> Geometry, Transform

# ---- group: Example get the robotic movement for a shape
upper_curve = Curve(scale.Geometry)
divide_3 = DivideCurve(Curve=upper_curve, Count=number_slider, Kinks=False)  # -> Points, Tangents, Parameters

# ---- group: Example get the robotic movement for a shape / Get Planar
pframe_2 = PerpFrame(Curve=upper_curve, Parameter=divide_3.Parameters)

# ---- group: Example get the robotic movement for a shape / Rotate Planar 30degree
deplane_7 = DeconstructPlane(Plane=pframe_2)  # -> Origin, XAxis, YAxis, ZAxis
rad_4 = Radians(Degrees=Slider(30, range=0..100))
rot3d_5 = Rotate3D(Geometry=pframe_2, Angle=rad_4, Center=deplane_7.Origin, Axis=deplane_7.XAxis)  # -> Geometry, Transform

# ---- group: Example get the robotic movement for a shape / Convert 66 items data into matrix 33 items
partition = PartitionList(List=weave_3, Size="2")
viewer = ParamViewer(partition)
ma = MassAddition(Input=partition)  # -> Result, PartialResults

# ---- group: Example get the robotic movement for a shape / Move Z value
deplane_8 = DeconstructPlane(Plane=rot3d_5.Geometry)  # -> Origin, XAxis, YAxis, ZAxis
multiplication_6 = Multiplication(A=deplane_8.ZAxis, B=Slider(-50, range=-100..-50))
move_4 = Move(Geometry=rot3d_5.Geometry, Motion=multiplication_6)  # -> Geometry, Transform

# ---- group: Example get the robotic movement for a shape / Robotic Movement
panel = Panel("""0
1
2""")
weave_4 = Weave(Pattern=panel, Stream0=move_4.Geometry, Stream1=rot3d_5.Geometry, Stream2=move_4.Geometry, NullGaps=False)
pline_3 = PolyLine(Vertices=weave_4, Closed=False)

move_5 = Move(Geometry=rot3d_4.Geometry, Motion=flatten(ma.Result))  # -> Geometry, Transform
deplane_9 = DeconstructPlane(Plane=move_5.Geometry)  # -> Origin, XAxis, YAxis, ZAxis
neg_3 = Negative(Value=deplane_9.ZAxis)
multiplication_7 = Multiplication(A=neg_3, B=Slider(50, range=0..100))
panel_2 = Panel("""1
0
2""")
move_6 = Move(Geometry=move_5.Geometry, Motion=multiplication_7)  # -> Geometry, Transform
weave_5 = Weave(
    Pattern=panel_2,
    Stream0=flatten(move_5.Geometry),
    Stream1=flatten(move_6.Geometry),
    Stream2=flatten(move_6.Geometry),
    NullGaps=False)
pline_4 = PolyLine(Vertices=weave_5, Closed=False)

# ---- group: Example get the robotic movement for a shape / Get midle points of the robotic movement for denser pattern
Z_3 = UnitZ(Factor=Slider(20, range=0..20))
move_7 = Move(Geometry=weave_5, Motion=Z_3)  # -> Geometry, Transform
midpt_2 = CurveMiddle(Curve=base_curve)
scale_2 = Scale(Geometry=move_7.Geometry, Center=midpt_2, Factor=Slider(0.67, range=0..1))  # -> Geometry, Transform

# ---- group: Example get the robotic movement for a shape (continued)
viewer_2 = ParamViewer(weave_3)
final_output = Curve(pline_4)
pline_5 = PolyLine(Vertices=scale_2.Geometry, Closed=False)
